# Grasshopper definition 2pts_curve.gh (Grasshopper 1.0.7)
# plug-ins: karambaGH

# ---- group: パラメーター
カテナリーの長さ = Slider(11, range=0..100)
始点 = Point(Point(0, 0, 0))
終点 = Point(Point(10, 0, 0))
pt1 = Point(Point(2.637432935, 0.03736232008, 2.654680945))
pt2 = Point(Point(6.563859096, 0, 2.961192488))
分割数 = Slider(17, range=0..100)
モデル選択 = Slider(0, range=0..2)

# ---- group: カテゴリー
dist = Distance(PointA=始点, PointB=終点)
max = Maximum(A=カテナリーの長さ, B=dist)
Z = UnitZ(Factor=1)
cat = Catenary(PointA=始点, PointB=終点, Length=max, Gravity=Z)

# ----
nurbs = NurbsCurve(Vertices=[始点, pt1, pt2, 終点], Degree=3, Periodic=False)  # -> Curve, Length, Domain

# ---- group: 円弧
arc = Arc3Pt(PointA=始点, PointB=pt1, PointC=終点)  # -> Arc, Plane, Radius

# ----
filter = StreamFilter(Gate=モデル選択, Stream0=cat, Stream1=arc.Arc, Stream2=nurbs.Curve)

# ---- group: karamba関連
divide = DivideCurve(Curve=filter, Count=分割数, Kinks=False)  # -> Points, Tangents, Parameters
Z_2 = UnitZ(Factor=1)
end = EndPoints(Curve=filter)  # -> Start, End
neg = Negative(Value=Z_2)
pline = PolyLine(Vertices=divide.Points, Closed=False)
supp = SupportKaramba3D(PosInd=end.Start, menu=[buttons(on, on, on, on, off, off)])
supp_2 = SupportKaramba3D(PosInd=end.End, menu=[buttons(on, on, on, off, off, off)])
loads = LoadsKaramba3D(Vector=neg, LCase=0, mode="Gravity")
explode = Explode(Curve=pline, Recursive=True)  # -> Segments, Vertices
linetobeam = LineToBeamKaramba3D(Line=explode.Segments, New=True, Remove=True, LimitDistance_m=0.005)  # -> Element, Points, Info
assemble = AssembleModelKaramba3D(Elem=linetobeam.Element, Support=[supp, supp_2], Load=loads, LimitDistance_m=0.005)  # -> Model, Info, Mass_kg, CenterOfGravity
analyze = AnalyzeKaramba3D(Model=assemble.Model)  # -> CalculatedModel, MaximumDisplacement_cm, ResultingForceOfGravity_kN, ElasticEnergy_kNm
modelview = ModelViewKaramba3D(Model=analyze.CalculatedModel, ResultFactors=1, ResultCase=-1)  # -> Model, DeformedMesh, DeformedAxes, DeformedModel
beamview = BeamViewKaramba3D(Model=modelview.Model)  # -> Model, MeshesOfRenderedBeams, DeformedBeamAxes, LegendColors, LegendTags
legend = Legend(Colour=beamview.LegendColors, Tags=beamview.LegendTags, LegendType=101)
b_forces = BeamForcesKaramba3D(AnalyzedModel=beamview.Model, LCase=-1, MaximumDistanceBetweenResults_m=-1, NumberOfResultsPerBeamElement=2)  # -> AnalyzedModel, NormalForce_kN, ShearForceVz_kN, ShearForceVy_kN, BendingMomentMt_kNm, BendingMomentMy_kNm, BendingMomentMz_kNm
panel = Panel(b_forces.NormalForce_kN)

# ---- group: ここで節点をcsv出力
panel_2 = Panel(divide.Points)
